% Simulink data dictionary datadic.sldd

J = Simulink.Parameter(3.2284e-6)
K = Simulink.Parameter(0.0274)
L = Simulink.Parameter(2.75e-6)
R = Simulink.Parameter(4)
b = Simulink.Parameter(3.5077e-6)
kd = Simulink.Parameter(0.13907)
ki = Simulink.Parameter(523.2955)
kp = Simulink.Parameter(17.3682)